# Grasshopper definition test-debug-helpers.gh (Grasshopper 1.0.7)

crv = Curve(<curve referenced from the Rhino model>)
curve_closure_exact = CSharpScript(x=crv)  # -> Closed, Start, End, EqualExtrema; inputs x: Curve
# ---------- curve_closure_exact: C# ----------
    if (x != null)
    {
      Closed = x.IsClosed;
      Start = x.PointAtStart;
      End = x.PointAtEnd;
      EqualExtrema = (x.PointAtStart == x.PointAtEnd);
    }
# ---------- end curve_closure_exact ----------
panel = Panel([curve_closure_exact.Closed, curve_closure_exact.Start, curve_closure_exact.End, curve_closure_exact.EqualExtrema])
