# Grasshopper definition PolylineCreateByJoiningLines.gh (Grasshopper 1.0.7)

number_slider = Slider(0.2, range=0.1..10)
line = Line([Line((-0.9999995137, -0.9999967687, -1.28792879e-06), (-0.001004140507, 0.001003196326, 4.564779992e-06)), Line((3.116167527e-06, 3.883714787e-06, 4.430212113e-06), (0.9999981456, 2.39351031e-07, 4.532073149e-06)), Line((0.9999957772, 1.708317109e-06, -2.341668046e-06), (0.9999950832, 0.9999952661, 3.75524664e-07)), Line((0.9999954011, 0.9999954466, 4.873869233e-06), (-2.855260297e-06, 0.9999976486, -4.530603965e-06)), Line((-3.702652677e-06, 0.9999978421, -1.623563236e-08), (4.374002437e-06, -1.111392316e-06, 2.827154807e-06))])
eval = EvaluateCurve(Curve=line, Parameter=0.5)  # -> Point, Tangent, Angle
c_script = CSharpScript(lines=line)  # -> out, A; inputs lines: list of Line
# ---------- c_script: C# ----------
A = Polyline.CreateByJoiningLines(lines, 0.01, true);
# ---------- end c_script ----------
points = PointList(Points=eval.Point, Size=number_slider)
move = Move(Geometry=c_script.A, Motion=Vector(2.35443014, -0.5333976256, 0))  # -> Geometry, Transform
explode = Explode(Curve=move.Geometry, Recursive=True)  # -> Segments, Vertices
eval_2 = EvaluateCurve(Curve=explode.Segments, Parameter=0.5)  # -> Point, Tangent, Angle
points_2 = PointList(Points=eval_2.Point, Size=number_slider)
